# Grasshopper definition SolarGAN_Hops_Template.gh (Grasshopper 1.0.7)
# plug-ins: Hops

path = FilePath("C:\Users\phili\Documents\GitHub\SolarGAN\beta_vae_idgan\data\graycube\sg_graycube__11.PNG")
image_resource = ImageResource(path)
hops = Hops(
    Path=path,
    CacheResultsInMemory=False,
    CacheSolveResults=False,
    RemoteDefinitionLocation="http://127.0.0.1:5000/att_processing",
    RemoteSolveVersion=(0, 1, 0),
    ShowInput_Enabled=False,
    ShowInput_Path=False,
    SynchronousSolve=True)  # -> C_mu, C_var
panel = Panel(hops.C_mu)
# 30: Glazing ratio
# 16: near far
# 12: up down
number_slider = Slider(12, range=0..100)
number_slider_2 = Slider(10, range=0..10)
hops_2 = Hops(
    C_mu=panel,
    C_dim=number_slider,
    Value=Slider(-1, range=-5..5),
    CacheResultsInMemory=False,
    CacheSolveResults=False,
    RemoteDefinitionLocation="http://127.0.0.1:5000/wwr_traversal",
    RemoteSolveVersion=(0, 1, 0),
    ShowInput_Enabled=False,
    ShowInput_Path=False,
    SynchronousSolve=True)
hops_3 = Hops(
    Run=Toggle(True),
    EnsembleSize=Slider(20, range=0..100),
    CacheResultsInMemory=False,
    CacheSolveResults=False,
    RemoteDefinitionLocation="http://127.0.0.1:5000/timeseries_gen",
    RemoteSolveVersion=(0, 1, 0),
    ShowInput_Enabled=False,
    ShowInput_Path=False,
    SynchronousSolve=True)
image_resource_2 = ImageResource(hops_2)
graph = QuickGraph(hops_3, SortOrder=0)
